# Grasshopper definition workflow.gh (Grasshopper 1.0.4)

python = GhPythonScript()  # -> out, cd
# ---------- python: Python ----------
__author__ = "ytakzk"
__version__ = "2018.12.04"

path = ghenv.Component.OnPingDocument().FilePath

separator = '/'
split = path.split(separator)

if len(split) < 2:
    separator = '\\'
    split = path.split(separator)

cd = separator.join(split[:-1]) + separator
# ---------- end python ----------
panel = Panel(python.cd)
python_2 = GhPythonScript(python="C:\tools\Anaconda2\envs\python36\python.exe", cd=python.cd, index=Slider(300, range=0..8400))  # -> out, succeeded; inputs index: Int32
# ---------- python_2: Python ----------
__author__ = "ytakzk"
__version__ = "2018.12.04"

from subprocess import call

path = cd + 'workflow.py'

command = '%s %s -index %d' % (python, path, index) 
print(command)
call(command.split(' '))
# ---------- end python_2 ----------
panel_2 = Panel(python_2.out)
python_3 = GhPythonScript(port=python_2.succeeded, cd=python.cd)  # -> mesh
# ---------- python_3: Python ----------
__author__ = "ytakzk"
__version__ = "2018.12.04"

import rhinoscriptsyntax as rs
import Rhino.Geometry as rg

path = cd + '/pointcloud2mesh/mount/output.off'

with open(path, 'r') as file:
    
    vertices = []
    faces = []
    
    for i, l in enumerate(file):
        
        if i < 2:
            continue
            
        vals = l.split(' ')
        
        if len(vals) == 3:
            vals = [float(v) for v in vals]
            vertices.append(vals)
        elif len(vals) == 4:
            vals = [int(v) for v in vals[1:]]
            faces.append(vals)
            
    mesh = rs.AddMesh(vertices, faces)
# ---------- end python_3 ----------
mesh = Mesh(python_3)
